# Dynamo graph 02 Dynamo_Loop_for_Model_Generation.dyn (Dynamo 1.3.2.2480)

# group: Nodes to Run Loop
string = StringInput("http://test.stfcnepal.com/test.php")
web_request = WebRequest(string)
code_block = CodeBlock(aa=web_request) { aa=="1"; true; false; }
if_ = If(test=code_block.out0, true=code_block.out1, false=code_block.out2)

watch = Watch(if_)

# group: Step 1.a: Read Sheet 1, Check if Row Index is within Limit and Ouput filepath
file_path = Filename("50go\test.xlsx")
code_block_2 = CodeBlock { "Sheet1"; true; "A1"; "BJ3"; }
read_excel = Custom[Read Excel](filePath=file_path, runIt=watch, sheetName=code_block_2.out0, origin=code_block_2.out2, extent=code_block_2.out3)  # This node will read an excel file. You can read an entore sheet contents, read from specific origin cell, read only specific range, or do all of the former for multiple sheets at the same time.
get_row_index_title_rows = CodeBlock(get=read_excel) { Math.Round(get[2][0]); get[0]; get[1]; }
check_if_row_index_is_within = CodeBlock(row=get_row_index_title_rows.out0) { row<50; }  # "Check if row index is within limit"
file_path_2 = Filename("50go\test.xlsx")
python_script = Python(IN[0]=check_if_row_index_is_within, IN[1]=file_path_2)
# ---------- python_script.python (12 lines) ----------
import clr
clr.AddReference('ProtoGeometry')
from Autodesk.DesignScript.Geometry import *
#The inputs to this node will be stored as a list in the IN variables.
dataEnteringNode = IN

bool = IN[0]

if bool == True:
	OUT = IN[1]

#Assign your output to the OUT variable.
# ----------------------------------------
row_number_to_copy_from_sheet_2 = CodeBlock(row=get_row_index_title_rows.out0) { row+3; }  # "Row Number to Copy from Sheet 2 to Sheet1"
code_block_3 = CodeBlock { "Error"; }
if_2 = If(test=check_if_row_index_is_within, true=row_number_to_copy_from_sheet_2, false=code_block_3)

# group: Step 2.a: Read current row from Sheet 2 Data and Write New Row to Sheet 1
code_block_4 = CodeBlock { "Sheet2"; false; }
first_letter = CodeBlock { "A"; }
row_index_start_value = CodeBlock(letra=first_letter, index=if_2) { letra+index; }
last_letter = CodeBlock { "BJ"; }
row_index_end_value = CodeBlock(letra=last_letter, index=if_2) { letra+index; }
read_excel_2 = Custom[Read Excel](filePath=python_script, runIt=watch, sheetName=code_block_4.out0, byColumn=code_block_4.out1, origin=row_index_start_value, extent=row_index_end_value)
passthrough = Custom[Passthrough](passThrough=python_script, waitFor=read_excel_2)  # Forces a sequential order of execution. The node wired into the output of the Passthrough node will be executed *after* the node wired into the waitFor input (e.g. important for some Revit operations). The value of the passThrough input will be passed on to the node wired into the output port of the Passthrough node.
code_block_5 = CodeBlock { "Sheet1"; "A1"; 0; true; }
flatten = Flatten(read_excel_2)
data_to_write = CodeBlock(titlerow1=get_row_index_title_rows.out1, titlerow2=get_row_index_title_rows.out2, valuerow=flatten) { data = {titlerow1,titlerow2,valuerow}; }
writeToFile = Excel.WriteToFile(filePath=passthrough, sheetName=code_block_5.out0, startRow=code_block_5.out2, startCol=code_block_5.out2, data=data_to_write, overWrite=code_block_5.out3)

# group: Step 3.a Get List of all windows' names
boolean = BoolSelector(false)
clean = List.Clean(list=writeToFile, preserveIndices=boolean)
transpose = List.Transpose(clean)
code_block_6 = CodeBlock { 0; }
getItemAtIndex = List.GetItemAtIndex(list=transpose@L2, index=code_block_6)
boolean_2 = BoolSelector(false)
list_clean_to_get_all_window = List.Clean(list=getItemAtIndex, preserveIndices=boolean_2)  # "List.Clean to get all window names"

# group: 3. c Sort Openings
categories = Categories("Windows")
all_elements_of_category = ElementsOfCategory(categories)
name = Element.Name(all_elements_of_category)
equals = Equals(name, list_clean_to_get_all_window, lacing=CrossProduct)
allFalse = AllFalse(equals@L2)
filterByBoolMask = List.FilterByBoolMask(list=all_elements_of_category, mask=allFalse)
name_2 = Element.Name()  # unwired: arg0
sortByFunction = SortByFunction(filterByBoolMask.out, name_2)
range_count_windows = CodeBlock(lista=list_clean_to_get_all_window) { 0..Count(lista)-1; }
dictionary_createdictionary_with = Lists.Dictionary.CreateDictionary(list_clean_to_get_all_window, range_count_windows)  # "Dictionary.CreateDictionary with window names as keys"
name_3 = Element.Name(sortByFunction)
getValueFromDictionary = Lists.Dictionary.GetValueFromDictionary(dictionary_createdictionary_with, name_3)
flatten_2 = Flatten(getValueFromDictionary)
sortByKey = List.SortByKey(list=sortByFunction, keys=flatten_2)

# group: 3.b Get separate list of EOs, Op Width, Op Height, Op Sill Height
code_block_7 = CodeBlock { 2; }
getItemAtIndex_2 = List.GetItemAtIndex(list=writeToFile, index=code_block_7)
restOfItems = List.RestOfItems(getItemAtIndex_2)
code_block_8 = CodeBlock { 4; }
list_chop_to_get_dim_per_window = List.Chop(list=restOfItems, lengths=code_block_8)
transpose_2 = List.Transpose(list_chop_to_get_dim_per_window)

code_block_9 = CodeBlock(get=transpose_2) { eo=get[0]; h=get[1]; w=get[2]; sh=get[3]; }

# group: Step 4.a Set Edge Opening Dimension
code_block_10 = CodeBlock()
# ---------- code_block_10.designscript (17 lines) ----------
{
"GF_Front_EO 1",
"GF_Front_EO 2",
"GF_Front_EO 3",
"FF_Front_EO 1",
"FF_Front_EO 2",
"FF_Front_EO 3",
"AF_Front_EO 1",
"AF_Front_EO 2",
"AF_Front_EO 3",
"GF_Side2_EO 1",
"GF_Side2_EO 2",
"FF_Side2_EO 1",
"FF_Side2_EO 2",
"AF_Side2_EO 2",
"AF_Side2_EO 1"
};
# ----------------------------------------
findByName = GlobalParameter.FindByName(code_block_10)
setValue = GlobalParameter.SetValue(findByName, code_block_9.eo)

# group: Step 4.b Set Opening Width, Height, Sill Height Dimensions
passthrough_2 = Custom[Passthrough](passThrough=sortByKey.sorted_list, waitFor=setValue)
code_block_11 = CodeBlock { "Sill Height"; "Height"; "Width"; }
code_block_12 = CodeBlock(sh=code_block_9.sh, h=code_block_9.h, w=code_block_9.w) { sillheight=sh; height=h; wodth=w; }
setParameterByName = Element.SetParameterByName(element=passthrough_2, parameterName=code_block_11.out0, value=code_block_12.sillheight)
elementType = Element.ElementType(setParameterByName)
setParameterByName_2 = Element.SetParameterByName(element=elementType, parameterName=code_block_11.out1, value=code_block_12.height)
setParameterByName_3 = Element.SetParameterByName(element=setParameterByName_2, parameterName=code_block_11.out2, value=code_block_12.wodth)

# group: Step 5: Export Current View As Image
views = Views("3D View 2")
passthrough_3 = Custom[Passthrough](waitFor=setParameterByName_3)  # unwired: passThrough
index = CodeBlock(row=get_row_index_title_rows.out0) { row+1; }
string_from_object = FromObject(index)
code_block_13 = CodeBlock { "."; }
split = String.Split(string_from_object, code_block_13)
code_block_14 = CodeBlock(str=split) { str[0]; }
get_status_of_house = CodeBlock(getlastitem=writeToFile) { getlastitem[-1][-1]; }
directory_path = Directory("C:\Users\BuildChange\Desktop\Final Test\50go")
code_block_15 = CodeBlock(pass=passthrough_3, rownum=code_block_14, status=get_status_of_house, view=views, dirp=directory_path) { pass; rownum; status; view; ext = ".jpg"; dirp; fullpath = dirp+"/"+status+"_"+rownum+"."+ext; }
export_range = ExportRangeUi("CurrentView")
image_file_type = ImageFileTypeUi("JPEGMedium")
zoom_fit_type = ZoomFitTypeUi("FitToPage")
code_block_16 = CodeBlock { 500; }
image_resolution = ImageResolutionUi("DPI_150")
code_block_17 = CodeBlock { 100; true; }
fit_direction_type = FitDirectionTypeUi("Horizontal")
export_image_by_view = Custom[Export Image by View](View=views, FilePath=code_block_15.fullpath, ExportRange=export_range, ImageFileType=image_file_type, ZoomFitType=zoom_fit_type, PixelSize=code_block_16, ImageResolution=image_resolution, ZoomPercentage=code_block_17.out0, FitDirectionType=fit_direction_type, RunIt=code_block_17.out1)  # This node will export a list of Views and save them as images (JPG, BMP etc).

comment = CodeBlock()  # //Activate Periodic Mode in Dynamo
step_4 = CodeBlock()  # // Assign new values to parameters to generate new revit model
